# Dynamo custom node SurfacePatternToCurves.dyf (Dynamo 2.0.3.8810)
# category: 3BMLabs.DigiFab
# Create gridline curves and intersection points from the surface pattern of the material of a (floor) element to use for the creation of (computer floor) tiles or pedestals to use for example in clash detection.

# group: INPUT
FloorElement = Input(FloorElement: var[]..[])

# group: Get Top Surface from Element
faces = Element.Faces(element=FloorElement)
code_block = CodeBlock(list=faces) { list[1]; }

# group: Clockwork: RevitFaceReference.FromDynamoSurface
list_create = List.Create(item0=code_block)
flatten = List.Flatten(list=list_create)
python_script = Python(IN[0]=flatten)
# ---------- python_script.python (13 lines) ----------
import clr
clr.AddReference('RevitAPI')
from Autodesk.Revit.DB import *

faces = UnwrapElement(IN[0])
elementlist = list()
for face in faces:
	try:
		ref = face.Tags.LookupTag("RevitFaceReference")
		elementlist.append(ref)
	except:
		elementlist.append(list())
OUT = elementlist
# ----------------------------------------
python_script_2 = Python(IN[0]=list_create, IN[1]=python_script)
# ---------- python_script_2.python (4 lines) ----------
check = IN[0]
items = IN[1]
if isinstance(check, (list)): OUT = items
else: OUT = items[0]
# ----------------------------------------

# group: Get Surface Pattern Dimensions
flatten_2 = List.Flatten(list=python_script_2)
python_script_3 = Python(IN[0]=flatten_2)
# ---------- python_script_3.python (121 lines) ----------
#https://thebuildingcoder.typepad.com/blog/2017/06/hatch-line-dimensioning-voodoo.html#4
#https://forum.dynamobim.com/t/get-surface-pattern-dimensions-count-tiles/30862

import clr
clr.AddReference('ProtoGeometry')
from Autodesk.DesignScript.Geometry import *

clr.AddReference('RevitAPIUI')
from Autodesk.Revit.UI import *

clr.AddReference('RevitServices')
import RevitServices
from RevitServices.Persistence import DocumentManager
from RevitServices.Transactions import TransactionManager

clr.AddReference('RevitNodes')
import Revit
clr.ImportExtensions(Revit.Elements)
clr.ImportExtensions(Revit.GeometryConversion)
clr.ImportExtensions(Revit.Elements)

clr.AddReference('RevitAPI')
import Autodesk

from Autodesk.Revit.DB import *
from Autodesk.Revit.DB.Architecture import *
from Autodesk.Revit.DB.Analysis import *
from Autodesk.Revit.Creation import *

from Autodesk.Revit.UI import TaskDialog
from Autodesk.Revit.UI import UIApplication
from Autodesk.Revit.UI.Selection import ObjectType

clr.ImportExtensions(Revit.GeometryConversion)

doc = DocumentManager.Instance.CurrentDBDocument
uidoc=DocumentManager.Instance.CurrentUIApplication.ActiveUIDocument

uiapp = DocumentManager.Instance.CurrentUIApplication
app = uiapp.Application

faces = IN[0]

for r in faces:
	e = uidoc.Document.GetElement(r)
	face = e.GetGeometryObjectFromReference(r)
	mattid= e.GetGeometryObjectFromReference(r).MaterialElementId
	matt=doc.GetElement(mattid)
	gridCount = doc.GetElement(matt.SurfacePatternId).GetFillPattern().GridCount #number of lines in pattern file
	test = doc.GetElement(matt.SurfacePatternId).Geometry
	StableRef=r.ConvertToStableRepresentation(doc)
	

_resArVER=[]
_resArVER2=[]
_resArHOR=[]


ip=0
while ip<2:
	indexVER=1+(ip*gridCount*2)
	indexHOR=2+(ip*gridCount*2)
	StableHatchStringVER=StableRef+'/'+str(indexVER)
	StableHatchStringHOR=StableRef+'/'+str(indexHOR)
	HatchRefVER=Reference.ParseFromStableRepresentation(doc,StableHatchStringVER)
	HatchRefHOR=Reference.ParseFromStableRepresentation(doc,StableHatchStringHOR)
	_resArVER.append(HatchRefVER)
	_resArHOR.append(HatchRefHOR)
	ip += 1
	
refArrVER=ReferenceArray()
refArrHOR=ReferenceArray()
for r in _resArVER:
	refArrVER.Append(r)
for r in _resArHOR:
	refArrHOR.Append(r)

GridDims=[]

TransactionManager.Instance.ForceCloseTransaction() #https://forum.dynamobim.com/t/name-a-transaction/23990

with Transaction(doc) as t:
	t.Start('dim')
	spoint=XYZ(1,0,0)
	spoint2=XYZ(0,1,0)
	epoint=XYZ(50,0,0)

	dimVER1 = doc.Create.NewDimension(doc.ActiveView,Line.CreateBound(spoint,epoint),refArrVER)
	dimVER2 = doc.Create.NewDimension(doc.ActiveView,Line.CreateBound(spoint2,epoint),refArrVER)
	dimHOR1 = doc.Create.NewDimension(doc.ActiveView,Line.CreateBound(spoint,epoint),refArrHOR)
	dimHOR2 = doc.Create.NewDimension(doc.ActiveView,Line.CreateBound(spoint2,epoint),refArrHOR)

	ElementTransformUtils.MoveElement(doc,dimVER1.Id,XYZ(1,0,0))
	ElementTransformUtils.MoveElement(doc,dimVER2.Id,XYZ(1,0,0))
	ElementTransformUtils.MoveElement(doc,dimHOR1.Id,XYZ(1,0,0))
	ElementTransformUtils.MoveElement(doc,dimHOR2.Id,XYZ(1,0,0))

	GridDims=int(dimVER1.ValueString),int(dimHOR1.ValueString)
	refPointsHOR=dimHOR1.Origin.ToPoint(),dimHOR2.Origin.ToPoint()
	refPointsVER= dimVER1.Origin.ToPoint(),dimVER2.Origin.ToPoint()

	t.Commit()

	t.Start('del')
	doc.Delete(dimVER1.Id)
	doc.Delete(dimVER2.Id)
	doc.Delete(dimHOR1.Id)
	doc.Delete(dimHOR2.Id)
	t.Commit()
	
	#Move outputs to level of floor surface
	
#bboxSrf = BoundingBox.ByGeometry(face.ToProtoType())
#minPtSrf = bboxSrf.MinPoint

#zDist = Point.Z(minPtSrf)
#GridDimsmove = Geometry.Translate(GridDimsmove,Vector.ZAxis,zDist)
#refPointsHORmove = Geometry.Translate(refPointsHOR,Vector.ZAxis,zDist)
#refPointsVERmove = Geometry.Translate(refPointsVER,Vector.ZAxis,zDist)

OUT=GridDims,face.ToProtoType(),refPointsHOR,refPointsVER
# ----------------------------------------
code_block_2 = CodeBlock(a=python_script_3) { length=a[0]; l1=length[0]; l2=length[1]; }
code_block_3 = CodeBlock(a=python_script_3) { surface=a[1]; }
code_block_4 = CodeBlock(a=python_script_3) { points=a[2]; p1=points[0]; p2=points[1]; }
code_block_5 = CodeBlock(a=python_script_3) { points=a[3]; p1=points[0]; p2=points[1]; }

# group: Move to level of surface
list_create_2 = List.Create(item0=code_block_4.points)
ZAxis = Vector.ZAxis()
boundingBox = Geometry.BoundingBox(geometry=code_block_3)
minPoint = BoundingBox.MinPoint(boundingBox=boundingBox)
Z = Point.Z(point=minPoint)
translate = Geometry.Translate(geometry=list_create_2, direction=ZAxis, distance=Z)
flatten_3 = List.Flatten(list=translate)
list_create_3 = List.Create(item0=code_block_5.points)
translate_2 = Geometry.Translate(geometry=list_create_3, direction=ZAxis, distance=Z)
flatten_4 = List.Flatten(list=translate_2)

# group: Create outputs
python_script_4 = Python(IN[0]=code_block_2.length, IN[1]=code_block_3, IN[2]=flatten_3, IN[3]=flatten_4)
# ---------- python_script_4.python (223 lines) ----------
import clr
clr.AddReference('ProtoGeometry')
#clr.AddReference('DSCoreNodes')
#from DSCore import *
#import System
import sys
sys.path.append("C:\Program Files (x86)\IronPython 2.7\Lib")

#from Autodesk.DesignScript import *
from Autodesk.DesignScript.Geometry import *

#The inputs to this node will be stored as a list in the IN variables.
dataEnteringNode = IN

	#Inputs

length = IN[0] #list

l1 = length[0]
l2 = length[1]

srf = IN[1]

test = srf[0]

pts = IN[2]

pts1 = pts[0]
pts2 = pts[1]

ptss = IN[3]

ptss1 = ptss[0]
ptss2 = ptss[1]

	#Create BoundingBox for distance

bbox = BoundingBox.ByGeometry(test)

minPt = bbox.MinPoint
maxPt = bbox.MaxPoint

dist = 5*Geometry.DistanceTo(maxPt,minPt)
#x*dist to find intersection at all times(still buggy)

	#Find intersection

line1 = Line.ByStartPointEndPoint(pts1,pts2)
line2 = Line.ByStartPointEndPoint(ptss1,ptss2)

curve1 = Curve.ExtendStart(line1,dist) 
curve2 = Curve.ExtendEnd(line1,dist)
curve3 = Curve.ExtendStart(line2,dist)
curve4 = Curve.ExtendEnd(line2,dist)

intsect1 = Geometry.Intersect(curve2,curve1)
intsect2 = Geometry.Intersect(curve4,curve3)

trim1 = Geometry.Trim(curve2,intsect1[0],pts1)
trim2 = Geometry.Trim(curve4,intsect2[0],ptss1)

join1 = Curve.Join(curve1,trim1)
join2 = Curve.Join(curve3,trim2)

intPoint = Geometry.Intersect(join1,join2)

	#Create grid

vec1 = Vector.ByTwoPoints(pts1,pts2)
vec2 = Vector.ByTwoPoints(pts2,pts1)
vec3 = Vector.ByTwoPoints(ptss1,ptss2)
vec4 = Vector.ByTwoPoints(ptss2,ptss1)

axis1 = Line.ByStartPointDirectionLength(intPoint[0],vec1,dist*2)
axis2 = Line.ByStartPointDirectionLength(intPoint[0],vec2,dist*2)
axis3 = Line.ByStartPointDirectionLength(intPoint[0],vec3,dist*2)
axis4 = Line.ByStartPointDirectionLength(intPoint[0],vec4,dist*2)

cntrPt1 = Curve.PointsAtSegmentLengthFromPoint(axis1,intPoint[0],l1)
cntrPt2 = Curve.PointsAtSegmentLengthFromPoint(axis2,intPoint[0],l1)
cntrPt3 = Curve.PointsAtSegmentLengthFromPoint(axis3,intPoint[0],l2)
cntrPt4 = Curve.PointsAtSegmentLengthFromPoint(axis4,intPoint[0],l2)

def convertArrayToList(array,extrapoint):
	output = []
	for i in array:
		output.append(i)
	output.append(extrapoint[0])
	
	return output

cntrPt1 = convertArrayToList(cntrPt1,intPoint)
cntrPt2 = convertArrayToList(cntrPt2,intPoint)
cntrPt3 = convertArrayToList(cntrPt3,intPoint)
cntrPt4 = convertArrayToList(cntrPt4,intPoint)

	#Align points in grid with corners of tiles

aligDist1 = l1/2
aligDist2 = l2/2

listcntr = [cntrPt1,cntrPt2,cntrPt3,cntrPt4]

lstAllignedGrid = []
for lst in listcntr: #nested for loop
	lstAllignedGridNested = []
	for pnt in lst:
		lstAllignedGridNested.append(Geometry.Translate(pnt,vec1,aligDist1))
	lstAllignedGrid.append(lstAllignedGridNested)

lstAllignedGrid2 = []
for lst in lstAllignedGrid:
	lstAllignedGridNested2 = []
	for pnt in lst:
		lstAllignedGridNested2.append(Geometry.Translate(pnt,vec4,aligDist2))
	lstAllignedGrid2.append(lstAllignedGridNested2)

crnrPt1 = lstAllignedGrid2[0]
crnrPt2= lstAllignedGrid2[1]
crnrPt3 = lstAllignedGrid2[2]
crnrPt4 = lstAllignedGrid2[3]

	#Create x-y axis lines
"""
def lineByStartPointDirectionLength(startpoint,direction,length):
	output = []
	for i in axis:
		output.append(i)
	output.append(Line.ByStartPointDirectionLength(startpoint,direction,length))
	
	return output

"""


xAxis1 = []
for x1 in crnrPt1:
	xAxis1.append(Line.ByStartPointDirectionLength(x1,vec3,dist*2)) #2*dist to find intersection at all times
xAxis2 = []
for x2 in crnrPt1:
	xAxis2.append(Line.ByStartPointDirectionLength(x2,vec4,dist*2))	
xAxis3 = []
for x3 in crnrPt2:
	xAxis3.append(Line.ByStartPointDirectionLength(x3,vec3,dist*2))
xAxis4 = []
for x4 in crnrPt2:
	xAxis4.append(Line.ByStartPointDirectionLength(x4,vec4,dist*2))
	
yAxis1 = []
for y1 in crnrPt3:
	yAxis1.append(Line.ByStartPointDirectionLength(y1,vec1,dist*2))
yAxis2 = []
for y2 in crnrPt3:
	yAxis2.append(Line.ByStartPointDirectionLength(y2,vec2,dist*2))	
yAxis3 = []
for y3 in crnrPt4:
	yAxis3.append(Line.ByStartPointDirectionLength(y3,vec1,dist*2))
yAxis4 = []
for y4 in crnrPt4:
	yAxis4.append(Line.ByStartPointDirectionLength(y4,vec2,dist*2))

	#Flatten axis lines

grid = [xAxis1,xAxis2,xAxis3,xAxis4,yAxis1,yAxis2,yAxis3,yAxis4] 

gridu = [xAxis1,xAxis2,xAxis3,xAxis4]

gridv = [yAxis1,yAxis2,yAxis3,yAxis4]

flatGrid = []
for sublist in grid:
    for item in sublist:
        flatGrid.append(item)     

	#Move grid to surface level

#flatGrid

Curve.PullOntoSurface

	#Create Output 1: cutGrid
        
cutGrid = []
for crvCut in flatGrid:
	cutGrid.append(Geometry.Intersect(srf[0],crvCut))	


flatGrid = []
for sublist in cutGrid:
    for item in sublist:
        flatGrid.append(item)     
	
	#Create Output 2: points for rasterwurks

startPts = []
for testpts in flatGrid:
	startPts.append(testpts.StartPoint)
	
endPts = []
for testpts in flatGrid:
	endPts.append(testpts.EndPoint)	
	
ptsList = [startPts,endPts]

trsplst = map(list, zip(*ptsList)) #Transpose items in list

	#Create Output 3: floor tiles
""""
#cutter1 = 

tester1 = []
for uLines in gridu:
	tester1.Append(Curve.Extrude(uLines,Vector.ZAxis))

cuttedsrf = Polysurface.ByjoinedSurfaces(extr)


Geometry.Split
"""



OUT = flatGrid, trsplst, gridu, gridv #cuttedsrf  #test,flatGrid,gridu,gridv
# ----------------------------------------
code_block_6 = CodeBlock(a=python_script_4) { a[0]; a[1]; a[2]; a[3]; }

# group: OUTPUT
GridV = Output(code_block_6.out3)
GridU = Output(code_block_6.out2)
Grouped_Perimeter_IntersectionPoints = Output(code_block_6.out1)
Gridlines = Output(code_block_6.out0)
Surface = Output(code_block_3)

perimeterCurves = Surface.PerimeterCurves()  # unwired: surface
