# Dynamo graph 3BMLabs.MakeUp Example file 1 - Creating Computer Floors WIP.dyn (Dynamo 2.0.3.8810)

select_model_element = DSModelElementSelection()  # 1 picked in the model; graph input
surfacePatternToCurves = Custom[SurfacePatternToCurves](FloorElement=select_model_element)  # Create gridline curves and intersection points from the surface pattern of the material of a (floor) element to use for the creation of (computer floor) tiles or pedestals to use for example in clash detection.

# group: Floor frame: Raster Wurks
family_types = FamilyTypes(index=701)  # graph input
byPoints = AdaptiveComponent.ByPoints(points=surfacePatternToCurves.Grouped_Perimeter_IntersectionPoints, familyType=family_types)

# group: Floor Tiles
flatten = List.Flatten(list=surfacePatternToCurves.GridU)  # frozen
ZAxis = Vector.ZAxis()
extrude = Curve.Extrude(curve=flatten, direction=ZAxis)
byJoinedSurfaces = PolySurface.ByJoinedSurfaces(surfaces=extrude)
split = Geometry.Split(geometry=surfacePatternToCurves.Surface, other=byJoinedSurfaces)
flatten_2 = List.Flatten(list=split)
flatten_3 = List.Flatten(list=surfacePatternToCurves.GridV)  # frozen
ZAxis_2 = Vector.ZAxis()
number_slider = DoubleSlider(510, range=0..1000 step 10)  # graph input
code_block = CodeBlock { 100; }

extrude_2 = Curve.Extrude(curve=flatten_3, direction=ZAxis)

# group (continued): Floor Tiles
byJoinedSurfaces_2 = PolySurface.ByJoinedSurfaces(surfaces=extrude_2)
split_2 = Geometry.Split(geometry=flatten_2, other=byJoinedSurfaces_2)
flatten_4 = List.Flatten(list=split_2)
translate = Geometry.Translate(geometry=flatten_4, direction=ZAxis_2, distance=number_slider)
thicken = Surface.Thicken(surface=translate, thickness=code_block)
byGeometry = ImportInstance.ByGeometry(geometry=thicken)
